# Grasshopper definition 曲线拟合为一条正圆弧.gh (Grasshopper 1.0.7)
# plug-ins: Hare

曲线 = GetGeometry(AtLeast=1, AtMost=2147483647, Filter=1073741828, Prompt="选择需要拟合为正圆弧的曲线(ENTER回车结束选取)")
curvepoint = PointOnCurve(曲线, parameter=0)
curvepoint_2 = PointOnCurve(曲线, parameter=0.5)
curvepoint_3 = PointOnCurve(曲线, parameter=1)
arc = Arc3Pt(PointA=curvepoint, PointB=curvepoint_2, PointC=curvepoint_3)  # -> Arc, Plane, Radius
end = EndPoints(Curve=arc.Arc)  # -> Start, End
midpt = CurveMiddle(Curve=arc.Arc)
context_bake = ContextBake(Geometry=arc.Arc)
ln = Line(StartPoint=end.Start, EndPoint=end.End)
crv_cp = CurveClosestPoint(Point=midpt, Curve=ln)  # -> Point, Parameter, Distance
round = Round(Number=crv_cp.Distance)  # -> Nearest, Floor, Ceiling
tag = TextTag(Location=midpt, Text=round.Nearest, Colour=RGB(255, 0, 0), Size=12)
